# Grasshopper definition ipadStand.gh (Grasshopper 1.0.7)
# plug-ins: ShapeDiverForGrasshopper

rectangle = Rectangle(
    Plane=PlaneXY(0, 0, 0),
    XSize=Slider(2.655, range=0..10),
    YSize=Slider(1.159, range=0..10),
    Radius=Slider(0.202, range=0..10))  # -> Rectangle, Length
rectangle_2 = Rectangle(Plane=PlaneXY(0, 0, 0), XSize=Slider(3, range=0..10), YSize=Slider(1.5, range=0..10), Radius=Slider(0.202, range=0..10))  # -> Rectangle, Length
Z = UnitZ(Factor=Slider(1.005, range=0..10))
Z_2 = UnitZ(Factor=Slider(1, range=0..10))
extr = Extrude(Base=rectangle.Rectangle, Direction=Z)
extr_2 = Extrude(Base=rectangle_2.Rectangle, Direction=Z_2)
cap = CapHoles(Brep=extr)
cap_2 = CapHoles(Brep=extr_2)
vec = VectorXYZ(XComponent=Slider(1.731, range=0..10), YComponent=Slider(0.472, range=0..10), ZComponent=Slider(0.458, range=0..10))  # -> Vector, Length
vec_2 = VectorXYZ(XComponent=Slider(1.557, range=0..10), YComponent=Slider(0.298, range=0..10), ZComponent=Slider(0.458, range=0..10))  # -> Vector, Length
move = Move(Geometry=cap, Motion=vec.Vector)  # -> Geometry, Transform
move_2 = Move(Geometry=cap_2, Motion=vec_2.Vector)  # -> Geometry, Transform
sdiff = SolidDifference(BrepsA=move_2.Geometry, BrepsB=move.Geometry)

panel = Panel("AirPods holder")
panel_2 = Panel("iPad back holder")
panel_3 = Panel("Base rectangle")

rectangle_3 = Rectangle(
    Plane=PlaneXY(0, 0, 0),
    XSize=Slider(6.045, range=0..10),
    YSize=Slider(5, range=0..10),
    Radius=Slider(1.195, range=0..10))  # -> Rectangle, Length
Z_3 = UnitZ(Factor=Slider(0.514, range=0..10))
extr_3 = Extrude(Base=rectangle_3.Rectangle, Direction=Z_3)
cap_3 = CapHoles(Brep=extr_3)

rectangle_4 = Rectangle(
    Plane=PlaneXY(0, 0, 0),
    XSize=Slider(4.216, range=0..10),
    YSize=Slider(1.591, range=0..10),
    Radius=Slider(1.195, range=0..10))  # -> Rectangle, Length
Z_4 = UnitZ(Factor=Slider(6.194, range=0..10))
extr_4 = Extrude(Base=rectangle_4.Rectangle, Direction=Z_4)
cap_4 = CapHoles(Brep=extr_4)
vec_3 = VectorXYZ(XComponent=Slider(0.918, range=-10..10), YComponent=Slider(-0.352, range=-10..10), ZComponent=Slider(4.783, range=0..10))  # -> Vector, Length
move_3 = Move(Geometry=cap_4, Motion=vec_3.Vector)  # -> Geometry, Transform
yz = YZPlane(Origin=Point(0, 0, 0))
rotate = Rotate(Geometry=move_3.Geometry, Angle=Slider(5.895, range=0..10), Plane=yz)  # -> Geometry, Transform

panel_4 = Panel("Base arm")

rectangle_5 = Rectangle(
    Plane=PlaneXY(0, 0, 0),
    XSize=Slider(4.216, range=0..10),
    YSize=Slider(1.974, range=0..10),
    Radius=Slider(0, range=0..10))  # -> Rectangle, Length
Z_5 = UnitZ(Factor=Slider(0.463, range=0..10))
extr_5 = Extrude(Base=rectangle_5.Rectangle, Direction=Z_5)
cap_5 = CapHoles(Brep=extr_5)
vec_4 = VectorXYZ(XComponent=Slider(0.918, range=-10..10), YComponent=Slider(-1.533, range=-10..10), ZComponent=Slider(4.783, range=0..10))  # -> Vector, Length
move_4 = Move(Geometry=cap_5, Motion=vec_4.Vector)  # -> Geometry, Transform
yz_2 = YZPlane(Origin=Point(0, 0, 0))
rotate_2 = Rotate(Geometry=move_4.Geometry, Angle=Slider(5.895, range=0..10), Plane=yz_2)  # -> Geometry, Transform

rectangle_6 = Rectangle(
    Plane=PlaneXY(0, 0, 0),
    XSize=Slider(4.216, range=0..10),
    YSize=Slider(1.591, range=0..10),
    Radius=Slider(1.195, range=0..10))  # -> Rectangle, Length
Z_6 = UnitZ(Factor=Slider(4.108, range=0..10))
extr_6 = Extrude(Base=rectangle_6.Rectangle, Direction=Z_6)
cap_6 = CapHoles(Brep=extr_6)
vec_5 = VectorXYZ(XComponent=Slider(0.926, range=0..10), YComponent=Slider(1.465, range=0..10), ZComponent=Slider(0.458, range=0..10))  # -> Vector, Length
move_5 = Move(Geometry=cap_6, Motion=vec_5.Vector)  # -> Geometry, Transform

panel_5 = Panel("Base height rectangle")

rectangle_7 = Rectangle(
    Plane=PlaneXY(0, 0, 0),
    XSize=Slider(4.216, range=0..10),
    YSize=Slider(0.236, range=0..10),
    Radius=Slider(0, range=0..10))  # -> Rectangle, Length
Z_7 = UnitZ(Factor=Slider(1, range=0..10))
extr_7 = Extrude(Base=rectangle_7.Rectangle, Direction=Z_7)
cap_7 = CapHoles(Brep=extr_7)
vec_6 = VectorXYZ(XComponent=Slider(0.918, range=-10..10), YComponent=Slider(-1.533, range=-10..10), ZComponent=Slider(5.241, range=0..10))  # -> Vector, Length
move_6 = Move(Geometry=cap_7, Motion=vec_6.Vector)  # -> Geometry, Transform
yz_3 = YZPlane(Origin=Point(0, 0, 0))
rotate_3 = Rotate(Geometry=move_6.Geometry, Angle=Slider(5.895, range=0..10), Plane=yz_3)  # -> Geometry, Transform

panel_6 = Panel("Base hand")
xy = XYPlane(Origin=Point(0, 0, 0))
pln_cell_phone_stand_design_origin = Plane(xy)
phone_length_mm = Slider(10, range=0..10)
# notes: This is a tolerance for the output.  This is related to the fabrication technique, a tolerance of 1 mm should be plenty.  If the fit is too loose, reduce this to 0.5mm.
phone_thickness = Slider(0.8, range=0..300)
# notes: Adjust the parameters until this model represents the phone you are designing for.
# notes: These parameters relate to how the phone will be used while in this stand.
phone_viewing_angle = Slider(67, range=0..360)
phone_corner_radius_mm = Slider(1, range=0..300)
portrait_landscape = ValueList({"portrait 0": "0", "landscape 90": "90", "portrait 180": "180", "landscape 270": "270"}, selected="landscape 90")
# notes: These parameters relate to the dimensions of the phone
# [with the case on, if applicable].
phone_table_offset = Slider(5, range=0..10)
phone_width_mm = Slider(8, range=0..10)
phone_tolerance_mm = Slider(1, range=0..2)
# notes: These parameters relate to the dimensions of the phone screen and viewing range. A void is created representing the viewing frustum.
phone_screen_offset_from_edge_mm = Slider(4, range=0..300)
num_screen_inset = Slider(3, range=3..100)
num_projection_offset = Slider(90, range=0..200)
num_projection_distance = Slider(200, range=0..200)
merge = Merge(Data1=cap_3, Data2=move_5.Geometry, Data3=rotate.Geometry, Data4=sdiff, Data5=rotate_2.Geometry, Data6=rotate_3.Geometry)
# notes: This is the model of the cell phone.
pln_cell_phone_stand_design_origin_2 = Plane(pln_cell_phone_stand_design_origin)
vec_7 = VectorXYZ(XComponent=Slider(-3.059, range=-10..10), YComponent=Slider(-1.583, range=-10..10), ZComponent=Slider(0, range=0..10))  # -> Vector, Length
num_phone_thickness = Number(phone_thickness)
num_phone_corner_radius = Number(phone_corner_radius_mm)
num_phone_width = Number(phone_width_mm)
num_phone_length = Number(phone_length_mm)
num_phone_viewing_angle = Number(phone_viewing_angle)
num_phone_viewing_orientation = Number(portrait_landscape)
num_phone_table_offset = Number(phone_table_offset)
num_phone_fit_tolerance = Number(phone_tolerance_mm)
num_screen_inset_2 = Number(num_screen_inset)
num_screen_offset_from_edge = Number(phone_screen_offset_from_edge_mm)
num_projection_distance_2 = Number(num_projection_distance)
num_projection_offset_2 = Number(num_projection_offset)
move_7 = Move(Geometry=merge, Motion=vec_7.Vector)  # -> Geometry, Transform
brep = Brep(move_7.Geometry)
sddp = ShapeDiverDocumentPayload({AbsoluteTolerance=0, AngleTolerance=0, DistanceDisplayPrecision=0, GltfVersion="Gltf2", GrasshopperVersion="1.0.0007", InputGroups="{}", OutputGroups="{}", RelativeTolerance=0, RhinoVersion="7.32.23221.10242", UnitSystem=0, VersionCreated="1.15.0.0", VersionSaved="1.15.0.0"})
cluster_cell_phone = ClusterCellPhone(
    pln_phone_location_on_table=pln_cell_phone_stand_design_origin_2,
    num_phone_viewing_angle=num_phone_viewing_angle,
    num_phone_viewing_orientation=num_phone_viewing_orientation,
    num_phone_table_offset=num_phone_table_offset,
    num_phone_width=num_phone_width,
    num_phone_length=num_phone_length,
    num_phone_corner_radius=num_phone_corner_radius,
    num_phone_thickness=num_phone_thickness,
    num_phone_fit_tolerance=num_phone_fit_tolerance,
    num_screen_offset_from_edge=num_screen_offset_from_edge,
    num_screen_projection_inset=num_screen_inset_2,
    num_projection_distance=num_projection_distance_2,
    num_projection_offset=num_projection_offset_2)  # -> pln_phone_origin_8, srf_phone_outline_surface_5, brep_phone_4, pln_phone_location_on_table_7, pln_phone_location_above_table_3, num_phone_volume_2, pt_phone_centroid_2, line_phone_center_of_gravity_2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
# notes: To make the phone visible, set the toggle to "true".
display_phone = BooleanToggle(True)
crv_phone_screen = Curve(cluster_cell_phone.crv_phone_screen_4)
brep_phone = Brep(cluster_cell_phone.brep_phone_4)
brep_phone_lens = Brep(cluster_cell_phone.brep_phone_lens_4)
display_phone_center_of_gravity_axis = BooleanToggle(False)
display_phone_field_of_view_cone = BooleanToggle(False)
display_phone_void = BooleanToggle(False)
pt_phone_centroid = Point(cluster_cell_phone.pt_phone_centroid_2)
line_phone_center_of_gravity = Curve(cluster_cell_phone.line_phone_center_of_gravity_2)
brep_phone_field_of_view_cone = Brep(cluster_cell_phone.brep_phone_field_of_view_cone_4)
# notes: This output is a volume representing the void for the phone and view. This will be removed from the output of the stand design.
brep_phone_void = Brep(cluster_cell_phone.brep_phone_void_2)
filter = StreamFilter(Gate=display_phone, Stream1=brep_phone)
filter_2 = StreamFilter(Gate=display_phone, Stream1=brep_phone_lens)
filter_3 = StreamFilter(Gate=display_phone, Stream1=crv_phone_screen)
filter_4 = StreamFilter(Gate=display_phone_center_of_gravity_axis, Stream1=line_phone_center_of_gravity)
filter_5 = StreamFilter(Gate=display_phone_field_of_view_cone, Stream1=brep_phone_field_of_view_cone)
filter_6 = StreamFilter(Gate=display_phone_void, Stream1=brep_phone_void)
preview = CustomPreview(Geometry=filter, Material=ColourSwatch(SwatchColor=RGB(145, 145, 145)))
preview_2 = CustomPreview(Geometry=filter_2, Material=ColourSwatch(SwatchColor=RGB(84, 84, 84)))
preview_3 = CustomPreview(Geometry=filter_3, Material=ColourSwatch(SwatchColor=RGB(99, 48, 48)))
preview_4 = CustomPreview(Geometry=filter_4, Material=ColourSwatch(SwatchColor=RGB(255, 0, 0)))
preview_5 = CustomPreview(Geometry=filter_5, Material=ColourSwatch(SwatchColor=RGBA(72, 184, 178, 186)))
preview_6 = CustomPreview(Geometry=filter_6, Material=ColourSwatch(SwatchColor=RGBA(184, 72, 72, 186)))

# ==== cluster ClusterCellPhone
num_phone_viewing_angle = ClusterInput()
num_phone_viewing_orientation = ClusterInput()
num_phone_table_offset = ClusterInput()
pln_phone_location_on_table = ClusterInput()
num_phone_width = ClusterInput()
num_phone_length = ClusterInput()
num_phone_corner_radius = ClusterInput()
num_phone_thickness = ClusterInput()
num_phone_fit_tolerance = ClusterInput()
num_screen_offset_from_edge = ClusterInput()
num_screen_projection_inset = ClusterInput()
num_projection_distance = ClusterInput()
num_projection_offset = ClusterInput()
num_phone_viewing_angle_2 = Number(num_phone_viewing_angle)
num_phone_table_offset_2 = Number(num_phone_table_offset)
num_phone_viewing_orientation_2 = Number(num_phone_viewing_orientation)
# notes: let us construct an origin point for the cell phone.
notes = Panel("phone body")
phone_location_x_coordinate = Slider(0, range=0..300)
phone_location_y_coordinate = Slider(0, range=0..300)
phone_location_z_coordinate = Slider(0, range=0..300)
num_projection_distance_2 = Number(num_projection_distance)
num_projection_offset_2 = Number(num_projection_offset)
num_screen_projection_inset_2 = Number(num_screen_projection_inset)
# notes: let us define the screen as an offset from the outside edge of the device
notes_2 = Panel("phone screen")
num_phone_thickness_2 = Number(num_phone_thickness)
num_phone_corner_radius_2 = Number(num_phone_corner_radius)
num_phone_width_2 = Number(num_phone_width)
num_phone_length_2 = Number(num_phone_length)
num_phone_fit_tolerance_2 = Number(num_phone_fit_tolerance)
camera35mmlenslength = Slider(24, range=18..80)
# notes: let us construct an origin point for the cell phone camera relative to the origin point of the phone.
notes_3 = Panel("phone camera lens")
# notes: let us construct a representation of the field of view for the camera.
phone_lens_view_depth = Slider(3000, range=0..3000)
phone_lens_location_x_coordinate = Slider(0, range=0..300)
phone_lens_location_y_coordinate = Slider(150, range=0..300)
phone_lens_location_z_coordinate = Slider(13, range=0..300)
phone_lens_rim_offset = Slider(3, range=0..300)
phone_lens_radius = Slider(5, range=0..25)
# notes: phone camera view frustum
phone_lens_thickness = Slider(0.5, range=0..2)
pln_phone_location_on_table_2 = Plane(pln_phone_location_on_table)
# notes: This is a point that will help us conceptually connect the virtual world to the physical world.
pt_phone_origin = ConstructPoint(
    XCoordinate=phone_location_x_coordinate,
    YCoordinate=phone_location_y_coordinate,
    ZCoordinate=phone_location_z_coordinate)
num_camera35mmlenslength = Number(camera35mmlenslength)
num_screen_offset_from_edge_2 = Number(num_screen_offset_from_edge)
vec_lens_location = VectorXYZ(
    XComponent=phone_lens_location_x_coordinate,
    YComponent=phone_lens_location_y_coordinate,
    ZComponent=phone_lens_location_z_coordinate)  # -> Vector, Length
# notes: right click on the grey box allows me to name this element.
pt_phone_origin_2 = Point(pt_phone_origin)
cluster = Cluster(num_camera35mmlenslength=num_camera35mmlenslength)
division = Division(A=num_phone_width_2, B="2.0")
# notes: a reference plane whose origin is that point
xy = XYPlane(Origin=pt_phone_origin_2)
neg = Negative(Value=division)
panel = Panel(division)
neg_2 = Negative(Value=num_screen_offset_from_edge_2)
num_fov = Number(cluster)
dom = ConstructDomain(DomainStart=division, DomainEnd=neg)
pln_phone_origin = Plane(xy)
pln_phone_origin_2 = Plane(pln_phone_origin)
move = Move(Geometry=pln_phone_origin_2, Motion=vec_lens_location.Vector)  # -> Geometry, Transform
pln_phone_lens_origin = Plane(move.Geometry)
cir = Circle(Plane=pln_phone_lens_origin, Radius=phone_lens_radius)
crv_phone_lens_outline = Curve(cir)
pln_phone_lens_origin_2 = Plane(pln_phone_lens_origin)
neg_3 = Negative(Value=phone_lens_rim_offset)
panel_2 = Panel(dom)
Z = UnitZ(Factor=phone_lens_view_depth)
# notes: here we create a fustrum that more accurately reflects the camera view and what is seen on screen.
pln_phone_lens_origin_3 = Plane(pln_phone_lens_origin)
multiplication = Multiplication(A="9", B=num_fov)
# notes: with this we can set up a view to see what the camera will see while in the stand.  we can also test whether specific object will be in the field of view.
multiplication_2 = Multiplication(A="16", B=num_fov)
offset = OffsetCurve(Curve=crv_phone_lens_outline, Distance=neg_3, Corners=1)
multiplication_3 = Multiplication(A=phone_lens_view_depth, B=multiplication)
multiplication_4 = Multiplication(A=phone_lens_view_depth, B=multiplication_2)
merge = Merge(Data1=crv_phone_lens_outline, Data2=offset)  # -> flatten(Result)
panel_3 = Panel(pln_phone_lens_origin_2)
move_2 = Move(Geometry=pln_phone_lens_origin_3, Motion=Z)  # -> Geometry, Transform
num_x_size = Number(multiplication_3)
num_y_size = Number(multiplication_4)
boundary = BoundarySurfaces(Edges=merge)
# notes: this creates a rectangle from the input of a plane, X dimension, and Y dimension.
phone_rectangle = Rectangle(Plane=pln_phone_origin, XSize=dom, YSize=num_phone_length_2, Radius=num_phone_corner_radius_2)  # -> Rectangle, Length
pln_phone_lens_origin_4 = Plane(move_2.Geometry)
num_phone_fit_tolerance_3 = Number(num_phone_fit_tolerance_2)
srf_phone_lens_outline_surface = Surface(boundary)
division_2 = Division(A=num_x_size, B="2.0")
division_3 = Division(A=num_y_size, B="2.0")
num_phone_thickness_3 = Number(num_phone_thickness_2)
rectangle_length = Panel(phone_rectangle.Length)
neg_4 = Negative(Value=division_2)
neg_5 = Negative(Value=division_3)
Z_2 = UnitZ(Factor=phone_lens_thickness)
crv_phone_outline = Curve(phone_rectangle.Rectangle)
crv_phone_outline_2 = Curve(crv_phone_outline)
offset_2 = OffsetCurve(Curve=crv_phone_outline_2, Distance=neg_2, Corners=1)
panel_4 = Panel(offset_2)
crv = Curve(flatten(offset_2))
crv_phone_outline_3 = Curve(crv_phone_outline)
dom_2 = ConstructDomain(DomainStart=division_2, DomainEnd=neg_4)
dom_3 = ConstructDomain(DomainStart=division_3, DomainEnd=neg_5)
num_x_2_0 = Number(expr("x*2.0", num_phone_fit_tolerance_3))
offset_3 = OffsetCurve(Curve=crv_phone_outline_3, Distance=num_phone_fit_tolerance_3, Corners=1)  # -> flatten(Curve)
Z_3 = UnitZ(Factor=num_phone_fit_tolerance_3)
extr = Extrude(Base=srf_phone_lens_outline_surface, Direction=Z_2)
boundary_2 = BoundarySurfaces(Edges=offset_3)
pln_phone_lens_origin_5 = Plane(pln_phone_lens_origin_2)
brep_phone_lens = Brep(extr)
addition = Addition(A=num_phone_thickness_3, B=num_x_2_0)
rectangle = Rectangle(Plane=pln_phone_lens_origin_4, XSize=dom_2, YSize=dom_3, Radius=0)  # -> Rectangle, Length
srf_tolerance_phone_outline_surface = Surface(boundary_2)
rev = Reverse(Vector=Z_3)
extr_2 = ExtrudePoint(Base=rectangle.Rectangle, Point=pln_phone_lens_origin_3)
# notes: this creates a surface from the curve.  the input curve becomes the surface edge.
boundary_3 = BoundarySurfaces(Edges=crv_phone_outline)
Z_4 = UnitZ(Factor=addition)
cap = CapHoles(Brep=extr_2)
srf_phone_outline_surface = Surface(boundary_3)
brep_phone_field_of_view_cone = Brep(cap)
move_3 = Move(Geometry=srf_tolerance_phone_outline_surface, Motion=rev)  # -> Geometry, Transform
Z_5 = UnitZ(Factor=num_phone_thickness_3)
extr_3 = Extrude(Base=move_3.Geometry, Direction=Z_4)
extr_4 = Extrude(Base=srf_phone_outline_surface, Direction=Z_5)
vec = Vector(Z_5)
move_4 = Move(Geometry=crv, Motion=vec)  # -> Geometry, Transform
crv_phone_screen = Curve(move_4.Geometry)
num_screen_projection_inset_3 = Number(num_screen_projection_inset_2)
num_projection_distance_3 = Number(num_projection_distance_2)
num_projection_offset_3 = Number(num_projection_offset_2)
cluster_2 = Cluster_2(
    crv_phone_screen=crv_phone_screen,
    num_screen_inset=num_screen_projection_inset_3,
    num_projection_distance=num_projection_distance_3,
    num_projection_offset=num_projection_offset_3)
brep_phone = Brep(extr_4)
brep_phone_field_of_view_cone_2 = Brep(brep_phone_field_of_view_cone)
brep_screen_viewing_volume = Brep(cluster_2)
srf_phone_outline_surface_2 = Surface(boundary_3)
brep_tolerance_phone = Brep(extr_3)
pln_phone_lens_origin_6 = Plane(pln_phone_lens_origin_5)
crv_phone_outline_4 = Curve(phone_rectangle.Rectangle)
crv_phone_screen_2 = Curve(move_4.Geometry)
pln_phone_origin_3 = Plane(xy)
brep_phone_lens_2 = Brep(brep_phone_lens)
brep_phone_2 = Brep(brep_phone)
pln_phone_location_on_table_3 = Plane(pln_phone_location_on_table_2)
merge_phone_components = Merge(
    Data1=pln_phone_origin_3,
    Data2=crv_phone_outline_4,
    Data3=srf_phone_outline_surface_2,
    Data4=brep_phone_2,
    Data5=brep_phone_lens_2,
    Data6=pln_phone_lens_origin_6,
    Data7=brep_phone_field_of_view_cone_2,
    Data8=crv_phone_screen_2,
    Data9=brep_tolerance_phone,
    Data10=brep_screen_viewing_volume)
num_phone_table_offset_3 = Number(num_phone_table_offset_2)
pln_phone_location_on_table_4 = Plane(pln_phone_location_on_table_3)

# ----
# notes: adjust phone location relative to table
phone_table_offset = Slider(16, range=-50..50)
num_phone_table_offset_4 = Number(num_phone_table_offset_3)
num_phone_table_offset_5 = Number(num_phone_table_offset_4)
Z_6 = UnitZ(Factor=num_phone_table_offset_5)
move_5 = Move(Geometry=pln_phone_location_on_table_4, Motion=Z_6)  # -> Geometry, Transform

pln_phone_location_above_table = Plane(move_5.Geometry)
pln_phone_location_on_table_5 = Plane(pln_phone_location_on_table_4)
vec2pt = Vector2Pt(PointA=pln_phone_location_on_table_5, PointB=pln_phone_location_above_table, Unitize=False)  # -> Vector, Length
vdis = VectorDisplay(Anchor=pln_phone_location_on_table_5, Vector=vec2pt.Vector)
num_phone_viewing_angle_3 = Number(num_phone_viewing_angle_2)
pln_phone_location_on_table_6 = Plane(pln_phone_location_on_table_2)
pln_phone_location_above_table_2 = Plane(pln_phone_location_above_table)
pln_phone_location_above_table_3 = ClusterOutput(pln_phone_location_above_table_2)
pln_phone_location_on_table_7 = ClusterOutput(pln_phone_location_on_table_6)

# ----
# notes: set the viewing orientation, "portrait/landscape"
geo_phone_components = Geometry(merge_phone_components)
portrait_landscape = ValueList({"portrait 0": "0", "landscape 90": "90", "portrait 180": "180", "landscape 270": "270"}, selected="landscape 90")
num_phone_viewing_orientation_3 = Number(num_phone_viewing_orientation_2)
item = ListItem(List=geo_phone_components, Index="0", Wrap=True)
item_2 = ListItem(List=geo_phone_components, Index="2", Wrap=True)
srf_phone_outline_surface_3 = Surface(item_2)
pln_phone_origin_4 = Plane(item)
area = Area(Geometry=srf_phone_outline_surface_3)  # -> Area, Centroid
pl_origin = PlaneOrigin(Base=pln_phone_origin_4, Origin=area.Centroid)

num_phone_viewing_orientation_4 = Number(num_phone_viewing_orientation_3)

rotate = Rotate(Geometry=geo_phone_components, Angle=degrees(num_phone_viewing_orientation_4), Plane=pl_origin)  # -> Geometry, Transform
geo_phone_components_2 = Geometry(rotate.Geometry)

# ----
# notes: move phone location based on orientation
pln_phone_location_above_table_4 = Plane(pln_phone_location_above_table)
geo_phone_components_3 = Geometry(geo_phone_components_2)
item_3 = ListItem(List=geo_phone_components_3, Index="0", Wrap=True)
pln_phone_origin_5 = Plane(item_3)
vec2pt_2 = Vector2Pt(PointA=pln_phone_origin_5, PointB=pln_phone_location_above_table_4, Unitize=False)  # -> Vector, Length
geo_phone_components_4 = Geometry(geo_phone_components_3)
item_4 = ListItem(List=geo_phone_components_4, Index="1", Wrap=True)
crv_phone_outline_5 = Curve(item_4)
crv_cp = CurveClosestPoint(Point=pln_phone_location_above_table_4, Curve=crv_phone_outline_5)  # -> Point, Parameter, Distance
vec2pt_3 = Vector2Pt(PointA=crv_cp.Point, PointB=pln_phone_location_above_table_4, Unitize=False)  # -> Vector, Length
move_6 = Move(Geometry=geo_phone_components_4, Motion=vec2pt_3.Vector)  # -> Geometry, Transform
vdis_2 = VectorDisplay(Anchor=crv_cp.Point, Vector=vec2pt_3.Vector)
geo_phone_components_5 = Geometry(move_6.Geometry)

# ----
# notes: rotate the phone to viewing position
geo_phone_components_6 = Geometry(geo_phone_components_5)
num_zero = Number(0)
item_5 = ListItem(List=geo_phone_components_6, Index="0", Wrap=True)
num_phone_viewing_direction = Number(num_zero)
pln_phone_origin_6 = Plane(item_5)
rotate_2 = Rotate(Geometry=geo_phone_components_6, Angle=degrees(num_phone_viewing_direction), Plane=pln_phone_origin_6)  # -> Geometry, Transform
geo_phone_components_7 = Geometry(rotate_2.Geometry)

pln_phone_location_above_table_5 = Plane(pln_phone_location_above_table_4)

# ----
# notes: rotate the phone to viewing position "up/down"
geo_phone_components_8 = Geometry(geo_phone_components_7)
phone_viewing_angle = Slider(72, range=0..360)
deplane = DeconstructPlane(Plane=pln_phone_location_above_table_5)  # -> Origin, XAxis, YAxis, ZAxis
num_phone_viewing_angle_4 = Number(num_phone_viewing_angle_3)
line = LineSDL(Start=deplane.Origin, Direction=deplane.XAxis, Length=1)
rotax = RotateAxis(Geometry=geo_phone_components_8, Angle=degrees(num_phone_viewing_angle_4), Axis=line)  # -> Geometry, Transform
geo_phone_components_9 = Geometry(rotax.Geometry)

geo_phone_components_10 = Geometry(geo_phone_components_9)
geo_phone_components_11 = Geometry(geo_phone_components_10)
geo_phone_components_12 = Geometry(geo_phone_components_11)
item_6 = ListItem(List=geo_phone_components_12, Index="0", Wrap=True)
item_7 = ListItem(List=geo_phone_components_12, Index="2", Wrap=True)
item_8 = ListItem(List=geo_phone_components_12, Index="3", Wrap=True)
item_9 = ListItem(List=geo_phone_components_12, Index="4", Wrap=True)
item_10 = ListItem(List=geo_phone_components_12, Index="6", Wrap=True)
item_11 = ListItem(List=geo_phone_components_12, Index="7", Wrap=True)
item_12 = ListItem(List=geo_phone_components_12, Index="8", Wrap=True)
item_13 = ListItem(List=geo_phone_components_12, Index="9", Wrap=True)
srf_phone_outline_surface_4 = Surface(item_7)
brep_phone_3 = Brep(item_8)
brep_phone_lens_3 = Brep(item_9)
pln_phone_origin_7 = Plane(item_6)
crv_phone_screen_3 = Curve(item_11)
brep_tolerance_phone_2 = Brep(item_12)
brep_screen_viewing_volume_2 = Brep(item_13)
brep_phone_field_of_view_cone_3 = Brep(item_10)
merge_2 = Merge(Data1=brep_tolerance_phone_2, Data2=brep_screen_viewing_volume_2)
volume = Volume(Geometry=brep_phone_3)  # -> Volume, Centroid
pt_phone_centroid = Point(volume.Centroid)
num_phone_volume = Number(volume.Volume)
sunion = SolidUnion(Breps=merge_2)
fmerge = MergeFaces(Brep=sunion)  # -> Breps, Before, After
project = Project(Geometry=pt_phone_centroid, Plane=pln_phone_location_on_table_6)  # -> Geometry, Transform
brep_phone_void = Brep(fmerge.Breps)
ln = Line(StartPoint=pt_phone_centroid, EndPoint=project.Geometry)
line_phone_center_of_gravity = Line(ln)
line_phone_center_of_gravity_2 = ClusterOutput(line_phone_center_of_gravity)
pln_phone_origin_8 = ClusterOutput(pln_phone_origin_7)
srf_phone_outline_surface_5 = ClusterOutput(srf_phone_outline_surface_4)
brep_phone_4 = ClusterOutput(brep_phone_3)
num_phone_volume_2 = ClusterOutput(num_phone_volume)
pt_phone_centroid_2 = ClusterOutput(pt_phone_centroid)
brep_phone_lens_4 = ClusterOutput(brep_phone_lens_3)
crv_phone_screen_4 = ClusterOutput(crv_phone_screen_3)
brep_tolerance_phone_3 = ClusterOutput(brep_tolerance_phone_2)
brep_screen_viewing_volume_3 = ClusterOutput(brep_screen_viewing_volume_2)
brep_phone_field_of_view_cone_4 = ClusterOutput(brep_phone_field_of_view_cone_3)
brep_phone_void_2 = ClusterOutput(brep_phone_void)

# ==== cluster Cluster
num_camera35mmlenslength = ClusterInput()
# notes: these values were determined empirically. this equation may require adjestment depending on your setup.
num_camera35mmlenslength_2 = Number(num_camera35mmlenslength)
num = Number("2/30")
num_2 = Number("40")
multiplication = Multiplication(A=num_2, B=num)
division = Division(A=multiplication, B=num_camera35mmlenslength_2)
panel = Panel(division)
panel_2 = Panel(multiplication)
num_fov = Number(division)
num_fov_2 = ClusterOutput(num_fov)

# ==== cluster Cluster_2
num_projection_distance = ClusterInput()
num_projection_offset = ClusterInput()
crv_phone_screen = ClusterInput()
num_screen_inset = ClusterInput()
num_projection_distance_2 = Number(num_projection_distance)
num_projection_offset_2 = Number(num_projection_offset)
crv_phone_screen_2 = Curve(crv_phone_screen)
num_screen_inset_2 = Number(num_screen_inset)
offset = OffsetCurve(Curve=crv_phone_screen_2, Distance=Slider(0, range=0..10), Corners=3)  # -> flatten(Curve)
crv_phone_screen_3 = Curve(offset)
boundary = BoundarySurfaces(Edges=crv_phone_screen_3)
area = Area(Geometry=boundary)  # -> Area, Centroid
srf_cp = SurfaceClosestPoint(Point=area.Centroid, Surface=boundary)  # -> Point, UVPoint, Distance
evalsrf = EvaluateSurface(Surface=boundary, Point=srf_cp.UVPoint)  # -> Point, Normal, UDirection, VDirection, Frame
num_projection_distance_3 = Number(num_projection_distance_2)
num_projection_offset_3 = Number(num_projection_offset_2)
num_screen_inset_3 = Number(num_screen_inset_2)
vec = Vector(evalsrf.Normal)
crv_phone_screen_4 = Curve(crv_phone_screen_3)
amp = Amplitude(Vector=vec, Amplitude=num_screen_inset_3)
amp_2 = Amplitude(Vector=vec, Amplitude=num_projection_distance_3)
move = Move(Geometry=crv_phone_screen_4, Motion=amp)  # -> Geometry, Transform
move_2 = Move(Geometry=move.Geometry, Motion=amp_2)  # -> Geometry, Transform
offset_2 = OffsetCurve(Curve=move_2.Geometry, Distance=num_projection_offset_3, Corners=1)  # -> flatten(Curve)
rulesrf = RuledSurface(CurveA=crv_phone_screen_4, CurveB=move.Geometry)
rulesrf_2 = RuledSurface(CurveA=move.Geometry, CurveB=offset_2)
cap = CapHoles(Brep=rulesrf)
cap_2 = CapHoles(Brep=rulesrf_2)
merge = Merge(Data1=cap, Data2=cap_2)
sunion = SolidUnion(Breps=merge)
brep_screen_viewing_volume = Brep(sunion)
brep_screen_viewing_volume_2 = ClusterOutput(brep_screen_viewing_volume)
